# Grasshopper definition stableDif_test00_230614.gh (Grasshopper 1.0.7)
# plug-ins: Printborg

panel = Panel("weird green cows")
path = FilePath("C:\Users\taole\source\repos\AI_Print\AI_Print\user_sketch\output\")
panel_2 = Panel("sk-KbD1s3SPXGcnNDDKkzdhSLKwPkP0GWQUtkbIsECaBj3Umeht")
panel_3 = Panel("100")
cyclomatron_x = SampleAsyncComponent(Generate=Button(), APIKey=panel_2, Prompt=Slider(34, range=0..100), FileDirectory=path, FileName="test1")  # -> Output, Debug, Debug_2; disabled
t2i = TextToImagePrompt(Generate=Button(), APIKey=panel_2, Prompt="weird green cows", FileDirectory=path)  # -> RawPOSTResponse, Link; disabled
models = GetControlnetModels(Send=Toggle(True), APIAddress="http://127.0.0.1:7860")  # -> Models, Debug
modules = GetControlnetModules(Send=Toggle(True), APIAddress="http://127.0.0.1:7860")  # -> Models, Debug
panel_4 = Panel(t2i.RawPOSTResponse)
panel_5 = Panel(t2i.Link)
item = ListItem(List=modules.Models, Index=Slider(22, range=0..50), Wrap=True)
panel_6 = Panel(item)
panel_7 = Panel(models.Models)
path_2 = FilePath("C:\Users\taole\source\repos\Printborg\PrintborgGH\user_sketch\scribbleTest_01.png")
ao_scripts = CreateAlwaysOnScripts(
    Model="control_v11p_sd15_scribble [d4ba51ff]",
    Module="scribble_hed",
    InputImage="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")
path_3 = FilePath("D:\Repos\Printborg\PrintborgGH\user_sketch\output\")
a1111payload = CreateAuto1111Payload(
    Prompt="delicious apple",
    NegativePrompt="bad, worse, low quality, strange, ugly",
    SamplerName="Euler",
    Steps="20",
    Width="128",
    Height="128",
    AlwaysOnScripts=ao_scripts)
a1111t2i = A1111TextToImageGeneration(Generate=Toggle(True), APIAddress="http://127.0.0.1:7860", Payload=a1111payload, FileDirectory=path_3, FileName="tests")  # -> Images, Strings, Debug
img = ImportImage()
img_2 = Image(a1111t2i.Images)
txt = Text(a1111t2i.Strings)
panel_8 = Panel(a1111t2i.Debug)
img_3 = Image(txt)
txt_2 = Text(img_2)
image = DisplayImage(Plane=PlaneXY(0, 0, 0), Scale=1)
panel_9 = Panel(txt_2)
gallery = ImageGallery(CycleDelay=30, Randomize=False, UseLocalImages=True, UseRemoteImages=True)
path_4 = FilePath(["D:\Repos\Printborg\PrintborgGH\user_sketch\Deforum_20230822170836\20230822170836.mp4", "D:\Repos\Printborg\PrintborgGH\user_sketch\Deforum_20230822170836\20230822170836_000000000.png", "D:\Repos\Printborg\PrintborgGH\user_sketch\Deforum_20230822170836\20230822170836_000000001.png", "D:\Repos\Printborg\PrintborgGH\user_sketch\Deforum_20230822170836\20230822170836_000000002.png", "D:\Repos\Printborg\PrintborgGH\user_sketch\Deforum_20230822170836\20230822170836_000000003.png", "D:\Repos\Printborg\PrintborgGH\user_sketch\Deforum_20230822170836\20230822170836_000000004.png"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])
division = Division(A="512", B=Slider(2, range=0..100))
item_2 = ListItem(List=path_4, Index=1, Wrap=True)
img_4 = ImportImage(File=item_2, XSamples=division, YSamples=division)

# ---- group: mesh resolution
number_slider = Slider(40, range=0..100)
number_slider_2 = Slider(40, range=0..100)

# ----
rec_objectboundary = Rectangle({Plane=PlaneXY(2.758546524, 2.608586538, 0), Size=Domain2(u=-13.04393851..13.04393851, v=-12.61862209..12.61862209)})

rec = Rectangle(rec_objectboundary)
area = Area(Geometry=rec)  # -> Area, Centroid
pdecon = Deconstruct(Point=area.Centroid)  # -> XComponent, YComponent, ZComponent
item_3 = ListItem(List=pdecon.ZComponent, Index=0, Wrap=True)  # -> Item, Item1
subtraction = Subtraction(A=item_3.Item, B=item_3.Item1)
abs = Absolute(Value=subtraction)
num_totalheight = Number(abs)

# ---- group: create base meshes
num = Number(number_slider_2)
num_2 = Number(number_slider)
mplane = MeshPlane(Boundary=rec_objectboundary, WidthCount=num, HeightCount=num_2)  # -> Mesh, Area
mesh_bottom = Mesh(mplane.Mesh)

# ---- group: drawing_inputShapes
crv = Curve(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)
crv_2 = Curve(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)

# ----
facen = FaceNormals()  # -> Centers, Normals
image_2 = ImageSampler(
    facen.Centers,
    FilePath="D:\Repos\Printborg\PrintborgGH\user_sketch\scribbleTest_01.png",
    Filter="Colour",
    Interpolate=False,
    Umax=1,
    Umin=0,
    Vmax=1,
    Vmin=0,
    Wrap=1)

# ---- group: object heights
number_slider_3 = Slider(30, range=0..50)
number_slider_4 = Slider(1, range=0..50)

# ---- group: create fields
crv_3 = Curve(crv)
crv_4 = Curve(crv_2)
num_isovalue = Number(Slider(-1.133, range=-20..20))
mesh_bottom_2 = Mesh(mesh_bottom)
mfield = MeshField(BaseMesh=mesh_bottom_2, DrawingInput=crv_4, IsoValue=num_isovalue, CurveResolution=1)
mfield_2 = MeshField(BaseMesh=mesh_bottom_2, DrawingInput=crv_3, IsoValue=num_isovalue, CurveResolution=1)
# these two blocks need
# to be replaced with the AI stuff
# - i.e. generating layers from
# input images and extracting
# toolpaths from the layers
data_fieldbottom = Data(mfield_2)
data_fieldtop = Data(mfield)

# ---- group: preview colors - will be interpolated
col = Colour([ColourSwatch(SwatchColor=RGB(166, 171, 19)), ColourSwatch(SwatchColor=RGB(8, 0, 255))])

# ---- group: calculate layer dimensions
num_totalheight_2 = Number(number_slider_3)
num_layerheight = Number(number_slider_4)
division_2 = Division(A=num_totalheight_2, B=num_layerheight)
dom = ConstructDomain(DomainStart=0, DomainEnd=num_totalheight_2)
range = Range(Domain=dom, Steps=division_2)
num_numlayers = Number(division_2)
num_layerheights = Number(range)

# ---- group: blend top and bottom fields to get intermediate layers
data_fieldbottom_2 = Data(data_fieldbottom)
data_fieldtop_2 = Data(data_fieldtop)
num_layersparamt = Number(Slider(12, range=0..20))
mesh_bottom_3 = Mesh(mesh_bottom)
range_2 = Range(Domain=Domain(0, 1), Steps=num_layersparamt)
fblendmult = BlendFieldsMultiThreaded(BaseMesh=mesh_bottom_3, Field0=data_fieldbottom_2, Field1=data_fieldtop_2, BlendParameters=range_2)  # -> Debug, BlendFields
data_layerfields = Data(fblendmult.BlendFields)

# ---- group: topBottomPreview
mesh_top = Mesh(mesh_bottom)
col_2 = Colour(col)
fdisp = FieldDisplay(Mesh=mesh_top, Field=data_fieldbottom, Colors=col_2)
fdisp_2 = FieldDisplay(Mesh=mesh_top, Field=data_fieldtop, Colors=col_2)

# ---- group: create mesh representations of layers
num_layerheights_2 = Number(num_layerheights)
mesh_bottom_4 = Mesh(mesh_bottom)
Z = UnitZ(Factor=num_layerheights_2)
move = Move(Geometry=mesh_bottom_4, Motion=Z)  # -> Geometry, Transform
mesh_layermeshes = Mesh(move.Geometry)

# ---- group: iso contour value
number_slider_5 = Slider(0.443, range=-20..20)

# ----
col_3 = Colour(col)

# ---- group: layer preview as fields
mesh_layermeshes_2 = Mesh(mesh_layermeshes)
data_layerfields_2 = Data(data_layerfields)
col_4 = Colour(col_3)
fdisp_3 = FieldDisplay(Mesh=mesh_layermeshes_2, Field=data_layerfields_2, Colors=col_4)

# ----
number_slider_6 = Slider(0, range=0..30)

# ---- group: extract frep object as layers
numisocontourvalue = Number(number_slider_5)
data_layerfields_3 = Data(data_layerfields)
mesh_layermeshes_3 = Mesh(mesh_layermeshes)
isoconmulti = IsoContour(Mesh=graft(mesh_layermeshes_3), Field=graft(data_layerfields_3), Tolerance=1, IsoValue=numisocontourvalue)
crv_toolpaths = Curve(isoconmulti)

# ----
item_4 = ListItem(List=data_layerfields_3, Index=0, Wrap=True)
item_5 = ListItem(List=mesh_layermeshes_3, Index=number_slider_6, Wrap=True)
item_6 = ListItem(List=data_layerfields_3, Index=number_slider_6, Wrap=True)
isoconmulti_2 = IsoContour(Mesh=graft(item_5), Field=graft(item_6), Tolerance=1, IsoValue=Slider(0.225, range=-20..20))
item_7 = ListItem(List=crv_toolpaths, Index=0, Wrap=True)
