# Grasshopper definition stableDif_test00_230614.gh (Grasshopper 1.0.7)
# plug-ins: AI_Print

path = FilePath("C:\Users\taole\source\repos\AI_Print\AI_Print\user_sketch\output\")
t2i = TextToImagePrompt(
    Generate=Button(),
    APIKey="sk-KbD1s3SPXGcnNDDKkzdhSLKwPkP0GWQUtkbIsECaBj3Umeht",
    Prompt="weird green cows",
    FileDirectory=path,
    FileName="test")  # -> RawPOSTResponse, Link
panel = Panel(t2i.RawPOSTResponse)
panel_2 = Panel(t2i.Link)
